# Grasshopper definition practice2.gh (Grasshopper 1.0.7)

catenary_scale = Slider(1.21, range=1..1.3)
grid_number = Slider(13, range=0..20)
unit_thickness = Slider(1.885, range=0..10)
roundness = Slider(0.63, range=0.1..1)
unit_scale = Slider(1.26, range=0.1..10)
unit_shape = Slider(0.55, range=0..1)
overall_size = Slider(78, range=1..100)
overall_size_2 = GetNumber(overall_size, AtLeast=1, AtMost=1, Maximum=1.797693135e+308, Minimum=-1.797693135e+308)
catenary_scale_2 = GetNumber(catenary_scale, AtLeast=1, AtMost=1, Maximum=1.797693135e+308, Minimum=-1.797693135e+308)
grid_number_2 = GetNumber(grid_number, AtLeast=1, AtMost=1, Maximum=1.797693135e+308, Minimum=-1.797693135e+308)
num = Number(unit_shape)
num_2 = Number(overall_size_2)
num_3 = Number(catenary_scale_2)
addition = Addition(A=num, B=roundness)
pt = ConstructPoint(XCoordinate=addition, YCoordinate=0, ZCoordinate=0)
rad = Radians(Degrees="120")
rad_2 = Radians(Degrees="30")
sin = Sine(Value=rad_2)
series = Series(Start=0, Step=rad, Count="3")
pi = Pi(Factor="1/2")
multiplication = Multiplication(A=num_2, B="1/2")
pt_2 = ConstructPoint(XCoordinate=0, YCoordinate=0, ZCoordinate=0)
X = UnitX(Factor=num_2)
multiplication_2 = Multiplication(A=num_2, B=num_3)
multiplication_3 = Multiplication(A=addition, B=sin)
rotate = Rotate(Geometry=pt, Angle=series, Plane=PlaneXY(0, 0, 0))  # -> Geometry, Transform
move = Move(Geometry=pt_2, Motion=X)  # -> Geometry, Transform
pt_3 = ConstructPoint(XCoordinate=multiplication, YCoordinate=multiplication, ZCoordinate=0)
series_2 = Series(Start=0, Step=pi, Count="4")
Z = UnitZ(Factor=1)
rad_3 = Radians(Degrees="60")
cir = Circle(Plane=PlaneXY(0, 0, 0), Radius=multiplication_3)
num_4 = Number(grid_number_2)
sin_2 = Sine(Value=rad_3)
cir_2 = Circle(Plane=rotate.Geometry, Radius=num)
cat = Catenary(PointA=pt_2, PointB=move.Geometry, Length=multiplication_2, Gravity=Z)
rdiff = RegionDifference(CurvesA=cir, CurvesB=cir_2)
Z_2 = UnitZ(Factor=1)
multiplication_4 = Multiplication(A=sin_2, B=num_4)
reb = RebuildCurve(Curve=cat, Degree="3", Count=10, Tangents=False)
rotate_2 = Rotate(Geometry=reb, Angle=series_2, Plane=pt_3)  # -> Geometry, Transform
dispatch = Dispatch(List=rotate_2.Geometry, DispatchPattern=[True, False])  # -> ListA, ListB
sph = Sphere(Base=PlaneXY(0, 0, 0), Radius=1)
extr = Extrude(Base=rdiff, Direction=Z_2)
hexgrid = Hexagonal(Plane=PlaneXY(0, 0, 0), Size=1, ExtentX=num_4, ExtentY=multiplication_4)  # -> Cells, Points
netsurf = NetworkSurface(CurvesU=dispatch.ListA, CurvesV=dispatch.ListB, Continuity=2)
flatten = FlattenTree(Tree=hexgrid.Cells, Path="{0}")
bbx = BrepBrep(BrepA=sph, BrepB=extr)  # -> Curves, Points
pt_4 = Point(hexgrid.Points)
srf = Surface(reparameterize(netsurf))
srfsplit = SurfaceSplit(Surface=sph, Curves=bbx.Curves)
bbox = BoundingBox(Content=flatten, Plane=PlaneXY(0, 0, 0), UnionBox=True)  # -> Box, Box_2
flip = Flip(Surface=srf)  # -> Surface, Result
srf_2 = Surface(reparameterize(bbox.Box))
bbox_2 = BoundingBox(Content=srfsplit, Plane=PlaneXY(0, 0, 0))  # -> Box, Box_2
srf_cp = SurfaceClosestPoint(Point=pt_4, Surface=srf_2)  # -> Point, UVPoint, Distance
area = Area(Geometry=bbox_2.Box)  # -> Area, Centroid
evalsrf = EvaluateSurface(Surface=flip.Surface, Point=srf_cp.UVPoint)  # -> Point, Normal, UDirection, VDirection, Frame
sort = SortList(Keys=area.Area, ValuesA=srfsplit)  # -> Keys, ValuesA
item = ListItem(List=sort.ValuesA, Index=0, Wrap=True)
len = Length(Curve=reb)
box_corners = BoxCorners(Box=item)  # -> CornerA, CornerB, CornerC, CornerD, CornerE, CornerF, CornerG, CornerH
division = Division(A=len, B=num_4)
dist = Distance(PointA=box_corners.CornerA, PointB=box_corners.CornerB)
division_2 = Division(A=division, B=dist)
num_5 = Number(unit_thickness)
num_6 = Number(unit_scale)
multiplication_5 = Multiplication(A=division_2, B=num_6)
Z_3 = UnitZ(Factor=num_5)
scale = Scale(Geometry=item, Center=Point(0, 0, 0), Factor=multiplication_5)  # -> Geometry, Transform
extr_2 = Extrude(Base=scale.Geometry, Direction=Z_3)
geo = Geometry(evalsrf.Frame)
box_corners_2 = BoxCorners(Box=extr_2)  # -> CornerA, CornerB, CornerC, CornerD, CornerE, CornerF, CornerG, CornerH
pdecon = Deconstruct(Point=box_corners_2.CornerA)  # -> XComponent, YComponent, ZComponent
pt_5 = ConstructPoint(XCoordinate=0, YCoordinate=0, ZCoordinate=pdecon.ZComponent)
orient = Orient(Geometry=extr_2, Source=pt_5, Target=geo)  # -> Geometry, Transform
wires = BrepWireframe(Brep=orient.Geometry, Density=-1)

# ---- group: RH_OUT:Shell
brep = Brep(orient.Geometry)

# ---- group: RH_OUT: wireframe
crv = Curve(wires)

# ----
preview = CustomPreview(Geometry=orient.Geometry, Material=ColourSwatch(SwatchColor=RGB(255, 255, 255)))
