# Grasshopper definition practice3.gh (Grasshopper 1.0.7)

md_slider = MDSlider(
    SliderMode=0,
    slider_value=Point(0.5089727401, 0.3320811249, 0.5),
    x_domain=Domain(0, 1),
    y_domain=Domain(0, 1),
    z_domain=Domain(0, 1))
min_distance = Slider(100, range=10..200)
domain_start = Slider(0.16, range=0.01..0.99)
domain_end = Slider(0.67, range=0.01..0.99)
x_for_attractor = Slider(10, range=0..100)
edge_length = Slider(11, range=1..100)
divide_number = Slider(5, range=2..10)
domain1 = GetNumber(domain_start, AtLeast=1, AtMost=1, Maximum=1.797693135e+308, Minimum=-1.797693135e+308)
domain2 = GetNumber(domain_end, AtLeast=1, AtMost=1, Maximum=1.797693135e+308, Minimum=-1.797693135e+308)
length = GetInteger(edge_length, AtLeast=1, AtMost=1, Maximum=2147483647, Minimum=-2147483648)
u = GetNumber(Slider(0.46, range=0..1), AtLeast=1, AtMost=1, Maximum=1.797693135e+308, Minimum=-1.797693135e+308)
v = GetNumber(Slider(0.6, range=0..1), AtLeast=1, AtMost=1, Maximum=1.797693135e+308, Minimum=-1.797693135e+308)
divide = GetInteger(divide_number, AtLeast=1, AtMost=1, Maximum=2147483647, Minimum=-2147483648)
num = Number(length)
num_2 = Number(divide)
pt = ConstructPoint(XCoordinate=u, YCoordinate=v, ZCoordinate=0)
division = Division(A=length, B=x_for_attractor)

# ---- group: domain
range = Range(Domain=Domain(0, 1), Steps=num_2)
consec = ConsecutiveDomains(Numbers=range, Additive=Toggle(False))
graft = GraftTree(Tree=consec, IncludeEmptyLists=True, IncludeNullItems=True)
dom² = ConstructDomain²(DomainU=consec, DomainV=graft)  # -> flatten(_2DDomain)

# ----
sph = Sphere(Base=PlaneXY(0, 0, 0), Radius=division)  # -> reparameterize(Sphere)
box = CenterBox(Base=PlaneXY(0, 0, 0), X=num, Y=num, Z=num)
evalsrf = EvaluateSurface(Surface=sph, Point=pt)  # -> Point, Normal, UDirection, VDirection, Frame
debrep = DeconstructBrep(Brep=box)  # -> Faces, Edges, Vertices
srf = Surface(reparameterize(graft(debrep.Faces)))
vec = Vector(evalsrf.Point)
geo = Geometry(box)
project = ProjectPoint(Point=evalsrf.Point, Direction=vec, Geometry=geo)  # -> Point, Index
subsrf = Isotrim(Surface=srf, Domain=dom²)  # -> flatten(Surface)
crv = Curve(graft(subsrf))
area = Area(Geometry=crv)  # -> Area, Centroid
pt_2 = Point(area.Centroid)

num_3 = Number(min_distance)
num_4 = Number(domain1)
num_5 = Number(domain2)
dist = Distance(PointA=pt_2, PointB=project.Point)
min = Minimum(A=dist, B=num_3)
bnd = Bounds(Numbers=flatten(min))
dom = ConstructDomain(DomainStart=num_4, DomainEnd=num_5)
remap = RemapNumbers(Value=min, Source=bnd, Target=dom)  # -> Mapped, Clipped

crv_2 = Curve(crv)
scale = Scale(Geometry=crv_2, Center=pt_2, Factor=remap.Mapped)  # -> Geometry, Transform
merge = Merge(Data1=crv_2, Data2=scale.Geometry)
crv_3 = Curve(scale.Geometry)
loft = Loft(Curves=merge, Options={Adjust=False, Closed=False, LoftEnds=0, LoftSimp=0, LoftType=0, Rebuild=10, Refit=0.01})
dup = DuplicateData(Data=dist, Number="3", Order=True)
pt_3 = Point(project.Point)
bnd_2 = Bounds(Numbers=flatten(dup))
sph_2 = Sphere(Base=pt_3, Radius="2")
remap_2 = RemapNumbers(Value=dup, Source=bnd_2, Target=Domain(0, 1))  # -> Mapped, Clipped
gradient = Gradient(
    LowerLimit=0,
    UpperLimit=1,
    Parameter=remap_2.Mapped,
    stops=[0: RGB(128, 255, 255), 0.677: RGB(0, 0, 255), 0.908: RGB(0, 0, 128)])
mesh = Mesh(sph_2)
mcol = MeshColours(Mesh=mesh, Colours=ColourSwatch(SwatchColor=RGB(38, 131, 237)))

# ---- group: RH_OUT: attractor
mesh_2 = Mesh(mcol)

# ----
srf_2 = Surface(reparameterize(graft(subsrf)))
num_6 = Number(num_2)
num_7 = Number(num)
pt_4 = Point(pt_2)
srf_cp = SurfaceClosestPoint(Point=pt_4, Surface=srf_2)  # -> Point, UVPoint, Distance
evalsrf_2 = EvaluateSurface(Surface=srf_2, Point=srf_cp.UVPoint)  # -> Point, Normal, UDirection, VDirection, Frame
neg = Negative(Value=evalsrf_2.Normal)

division_2 = Division(A=num_7, B=num_6)
division_3 = Division(A=division_2, B="2")
num_8 = Number(remap.Mapped)
multiplication = Multiplication(A=division_3, B=num_8)

amp = Amplitude(Vector=neg, Amplitude=multiplication)

move = Move(Geometry=pt_4, Motion=amp)  # -> Geometry, Transform
extr = ExtrudePoint(Base=crv_3, Point=move.Geometry)
merge_2 = Merge(Data1=loft, Data2=extr)
join = BrepJoin(Breps=merge_2)  # -> Breps, Closed
join_2 = BrepJoin(Breps=flatten(join.Breps))  # -> Breps, Closed
preview = CustomPreview(Geometry=join.Breps, Material=ColourSwatch(SwatchColor=RGB(26, 48, 73)))
brep = Brep(join_2.Breps)
brep_2 = Brep(join.Breps)
mesh_3 = Mesh(brep_2)
wires = BrepWireframe(Brep=brep_2, Density=-1)
pshift = ShiftPaths(Data=wires, Offset=-1)
join_3 = JoinCurves(Curves=pshift, Preserve=False)
c_script = CSharpScript(crv=join_3, color=gradient)  # -> out, A; inputs crv: Curve, color: Color
# ---------- c_script: C# ----------
    var c = color.R + "," + color.G + "," + color.B;
    crv.SetUserString("color", c);
    A = crv;
# ---------- end c_script ----------

# ---- group: RH_OUT: wireframe
crv_4 = Curve(c_script.A)
